# Grasshopper definition script.gh (Grasshopper 1.0.4)
# plug-ins: Pufferfish, Squid, Colibri, HFTidyCanvas

number_slider = DataDescription(Slider(256, range=0..1000))
iter = Slider(20, range=0..20)
number_slider_2 = NumberSlider(number_slider)
dom = ConstructDomain(DomainStart=expr("-x/2", number_slider), DomainEnd=expr("x/2", number_slider))
iterator = ColibriIterator(iter=iter, ignoreAllWarningMsg=False, RemoteFly=False)  # -> Value, Value_N, IterationGenome
number_slider_3 = NumberSlider(number_slider_2)
rectangle = Rectangle(Plane=PlaneXY(0, 0, 0), XSize=dom, YSize=dom, Radius=0)  # -> Rectangle, Length
value = DataDescription(iterator.Value)
refresher = GhPythonScript(r=rectangle.Rectangle, y=value)  # -> r
# ---------- refresher: Python ----------
__author__ = "ismahelio"
__version__ = "2023.10.03"

r = r
# ---------- end refresher ----------
rectangle_2 = DataDescription(refresher)
circle = GhPythonScript(x=rectangle_2)  # -> out, pts, rad, ptsR, xs, ys
# ---------- circle: Python ----------
__author__ = "ismahelio"
__version__ = "2023.10.03"

import rhinoscriptsyntax as rs
from random import randint, uniform
import Rhino

n = randint(1,20)
pts = []
rad = []

for i in range(n):
    x = uniform(-100, 100)
    y = uniform(-100, 100)
    pt = rs.CreatePoint(x,y,0)
    pts.append(pt)
    rad.append(uniform(5, 20))

n = randint(1,20)
ptsR = []
ys = []
xs = []
for i in range(n):
    x = uniform(-100, 100)
    y = uniform(-100, 100)
    pt = rs.CreatePoint(x,y,0)
    ptsR.append(pt)
    xs.append(uniform(5, 40))
    ys.append(uniform(5, 40))
# ---------- end circle ----------
rectangle_3 = Rectangle(rectangle_2)
dom_2 = ConstructDomain(DomainStart=expr("-x/2", circle.xs), DomainEnd=expr("x/2", circle.xs))
dom_3 = ConstructDomain(DomainStart=expr("-x/2", circle.ys), DomainEnd=expr("x/2", circle.ys))
cir = Circle(Plane=circle.pts, Radius=circle.rad)
rectangle_4 = Rectangle(Plane=circle.ptsR, XSize=dom_2, YSize=dom_3, Radius=0)  # -> Rectangle, Length
rectangle_5 = DataDescription(rectangle_4.Rectangle)
circle_2 = DataDescription(cir)
X = UnitX(Factor=number_slider_3)
rectangle_6 = Rectangle(rectangle_3)
merge = Merge(Data1=rectangle_5, Data2=circle_2)
move = Move(Geometry=rectangle_6, Motion=X)  # -> Geometry, Transform
move_2 = Move(Geometry=circle_2, Motion=X)  # -> Geometry, Transform
move_3 = Move(Geometry=rectangle_5, Motion=X)  # -> Geometry, Transform
result = DataDescription(graft(merge))
cir_2 = DataDescription(graft(move_2.Geometry))
merge_2 = Merge(Data1=rectangle_6, Data2=move.Geometry)
rec = DataDescription(graft(move_3.Geometry))
brec = BoundingRectangle(Geometry=merge_2, Plane=PlaneXY(0, 0, 0), Axis=0, Slide=0, Union=True)  # -> Bounding, DimensionX, DimensionY
number_slider_4 = Slider(2, range=0..10)
outline = Outline(Color=ColourSwatch(SwatchColor=RGB(0, 0, 0)), Width=Slider(2, range=0..10))
fills = FillSolid(Color=ColourSwatch(SwatchColor=RGB(255, 128, 0)))
fills_2 = FillSolid(Color=ColourSwatch(SwatchColor=RGB(255, 255, 255)))
fills_3 = FillSolid(Color=ColourSwatch(SwatchColor=RGB(51, 51, 51)))
dimension_x = DataDescription(brec.DimensionX)
dimension_y = DataDescription(brec.DimensionY)
save = Save(Folder="\\Mac\Home\Desktop\repos\pix2pix-tensorflow\gh\train", Filename=Slider(0, range=0..100), Tiff=False)  # -> SquidInstr, Path
canvas = DataDescription(brec.Bounding)
drawex = DrawEx(Curves=result, Accuracy=number_slider_4, Outline=outline, Fill=fills_2, Mode=False)  # -> SquidInstr, Curve
drawex_2 = DrawEx(Curves=cir_2, Accuracy=number_slider_4, Fill=fills, Mode=False)  # -> SquidInstr, Curve
drawex_3 = DrawEx(Curves=rec, Accuracy=number_slider_4, Fill=fills_3, Mode=False)  # -> SquidInstr, Curve
save_2 = DataDescription(save.SquidInstr)
color_rect = DataDescription(drawex_3.SquidInstr)
color_cir = DataDescription(drawex_2.SquidInstr)
color_rect_2 = ColorRect(color_rect)
color_cir_2 = ColorCir(color_cir)
save_3 = Save(save_2)
clear = Clear(Color=ColourSwatch(SwatchColor=RGB(255, 255, 255)))
canvas_2 = Canvas(canvas)
merge_3 = Merge(
    Data1=flatten(clear),
    Data2=flatten(drawex.SquidInstr),
    Data3=flatten(color_rect_2),
    Data4=flatten(color_cir_2),
    Data5=flatten(save_3))  # -> flatten(Result)
squid = Squid(BitmapR=canvas_2, SquidInstr=merge_3, PPU=Slider(1, range=0..10), AA=True, autohide=False)
